# Grasshopper definition Merge.gh (Grasshopper 1.0.4)

panel = Panel("""4
4
3
3
2
2
1
1""")
panel_2 = Panel("""4
4""")
panel_3 = Panel("""2
2
1
3
1
4
1
2
2
2
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""")
entwine = Entwine(Branch00=panel, Branch01=panel, FlattenInputs=True)
entwine_2 = Entwine(Branch00=panel_2, Branch01=panel_2, FlattenInputs=True)
entwine_3 = Entwine(Branch00=panel_3, Branch01=panel_3, FlattenInputs=True)
relative = GhPythonScript(file="merge.py")  # -> out, a
# ---------- relative: Python ----------
import rhinoscriptsyntax as  rs
import os

folder = rs.WorkingFolder()
a = os.path.join(folder, file)
# ---------- end relative ----------
file = ReadFile(File=relative.a, PerLineParse=False)
merge = GhPythonScript(Code=file, Floors=entwine, Cells=entwine_3, Borders=entwine_2)  # -> Out, A
panel_4 = Panel(merge.Out)
panel_5 = Panel(merge.A)
